# Dynamo graph Core_Math.dyn (Dynamo 0.8.2.2082)

# note: 提示: 选择绘制几何图形的节点会使其创建的几何图形变为蓝色。该代码块绘制图形的轴、沿曲线的点、以及曲线本身。选择代码块，以查看在背景中绘制的是哪条曲线。

# note: 公式节点的文档请参见 http://ncalc.codeplex.com/
code_block = CodeBlock { -10..10..#20; }
byCoordinates = Point.ByCoordinates(x=code_block, y=code_block, lacing=CrossProduct)
flatten = Flatten(byCoordinates)
Y = Point.Y(flatten)
# note: 将几何图形移到
code_block_2 = CodeBlock(x=Y) { x+60; }
X = Point.X(flatten)
number_slider = DoubleSlider(5.51, range=0..10 step 0.1)
number_slider_2 = DoubleSlider(1.724, range=0..5 step 0.1)
# note: 由于公式节点使用外部函数，所以它将角度处理为弧度。
formula = Formula("A * sin( sqrt( pow(x,2) + pow(y,2) + pow(c,2) ) ) / sqrt( pow(x,2) + pow(y,2) + pow(c,2) )", A=number_slider, x=X, y=Y, c=number_slider_2)
byCoordinates_2 = Point.ByCoordinates(x=code_block_2, y=X, z=formula)
count = List.Count(byCoordinates)
chop = List.Chop(byCoordinates_2, count)
byPoints = NurbsCurve.ByPoints(chop)
byLoft = Surface.ByLoft(byPoints)
# note: 该示例显示了处理数学函数的四种不同方法。这些示例都以点的网格为起点，计算点的 Z 坐标，然后生成曲面。这些方法都解决相同的问题，只是计算方法有所不同。
# 1. 节点。数学节点在 Core/Math/ 中
# 2. Python。
# 3. 公式节点。这是单独的开源项目，可通过 Dynamo 获得。公式节点的文档请查看 http://ncalc.codeplex.com/
# 4. 代码块节点。在画布的任意位置双击可创建代码块节点。每个函数的语法与 Dynamo 中节点的名称相匹配。
# ** 注意: 通过“设置”菜单可以调整几何图形预览的分辨率.
code_block_3 = CodeBlock { -10..10..#20; }
# note: 生成点的网格。
# 注意连缀行为是
# “叉积”
# note: 提示: 调整背景预览中几何图形的渲染精度。在“设置”菜单上，选择“渲染精度”。较高值会使曲面看起来更平滑，但需要更多系统处理能力进行绘制。
# note: 有关更多示例请参见:
# http://dynamobim.org/math-transit/
byCoordinates_3 = Point.ByCoordinates(x=code_block_3, y=code_block_3, lacing=CrossProduct)
flatten_2 = Flatten(byCoordinates_3)
X_2 = Point.X(flatten_2)
Y_2 = Point.Y(flatten_2)
number_slider_3 = DoubleSlider(5.51, range=0..10 step 0.1)
number = DoubleInput(2)
pow = Math.Pow(number=X_2, power=number)
number_2 = DoubleInput(2)
pow_2 = Math.Pow(number=Y_2, power=number_2)
add = pow + pow_2
number_slider_4 = DoubleSlider(1.724, range=0..5 step 0.1)
number_3 = DoubleInput(2)
pow_3 = Math.Pow(number=number_slider_4, power=number_3)
add_2 = add + pow_3
sqrt = Math.Sqrt(add_2)
# note: 在 Dynamo 中角度以度为单位
radiansToDegrees = Math.RadiansToDegrees(sqrt)
sin = Math.Sin(radiansToDegrees)
div = sin / sqrt
mul = number_slider_3 * div
byCoordinates_4 = Point.ByCoordinates(x=X_2, y=Y_2, z=mul)
count_2 = List.Count(byCoordinates_3)
# note: 将平级列表按行分割为
# 列表系列
chop_2 = List.Chop(byCoordinates_4, count_2)
# note: 通过各点创建 NURBS
# 曲线
byPoints_2 = NurbsCurve.ByPoints(chop_2)
# note: 创建曲面
byLoft_2 = Surface.ByLoft(byPoints_2)
code_block_4 = CodeBlock { -10..10..#20; }
byCoordinates_5 = Point.ByCoordinates(x=code_block_4, y=code_block_4, lacing=CrossProduct)
flatten_3 = Flatten(byCoordinates_5)
Y_3 = Point.Y(flatten_3)
code_block_5 = CodeBlock(x=Y_3) { x+90; }
X_3 = Point.X(flatten_3)
number_slider_5 = DoubleSlider(1.724, range=0..5 step 0.1)
number_slider_6 = DoubleSlider(5.51, range=0..10 step 0.1)
# note: 数学方法函数的名称与第一个示例中使用的 Dynamo 节点名称匹配。
code_block_6 = CodeBlock(x=X_3, y=Y_3, c=number_slider_5, A=number_slider_6)
# ---------- code_block_6.designscript (6 lines) ----------
sum = Math.Pow(x,2) + Math.Pow(y,2) + Math.Pow(c,2);

num1 = Math.Sqrt(sum);
num2 = Math.Sin( Math.RadiansToDegrees(num1) );

A * num2 / num1;
# ----------------------------------------
byCoordinates_6 = Point.ByCoordinates(x=code_block_5, y=X_3, z=code_block_6.out3)
count_3 = List.Count(byCoordinates_5)
chop_3 = List.Chop(byCoordinates_6, count_3)
byPoints_3 = NurbsCurve.ByPoints(chop_3)
byLoft_3 = Surface.ByLoft(byPoints_3)
code_block_7 = CodeBlock { -10..10..#20; }
byCoordinates_7 = Point.ByCoordinates(x=code_block_7, y=code_block_7, lacing=CrossProduct)
flatten_4 = Flatten(byCoordinates_7)
X_4 = Point.X(flatten_4)
code_block_8 = CodeBlock(x=X_4) { x+30; }
Y_4 = Point.Y(flatten_4)
number_slider_7 = DoubleSlider(5.51, range=0..10 step 0.1)
number_slider_8 = DoubleSlider(1.724, range=0..5 step 0.1)
python_script = Python(IN[0]=number_slider_7, IN[1]=X_4, IN[2]=Y_4, IN[3]=number_slider_8)
# ---------- python_script.python (27 lines) ----------
import clr
clr.AddReference('ProtoGeometry')
from Autodesk.DesignScript.Geometry import *

import math

# The inputs to this node will be stored as a list in the IN variable.
amp = IN[0]   # single value
x = IN[1]     # list
y = IN[2]     # list (expect same length as x)
c = IN[3]     # single value

# Declare an empty array of z-values
z = []

# Solve the equation for each x and y value
for index in range(len(x)):
	sum = math.pow(x[index],2) + math.pow(y[index],2) + math.pow(c,2)
	num1 = math.sqrt(sum)
	num2 = math.sin(num1)
	zVal = amp * num2 / num1
	
	# Append the answer to the list of z values
	z.append(zVal)

# Assign the z-values to the OUT variable
OUT = z
# ----------------------------------------
byCoordinates_8 = Point.ByCoordinates(x=code_block_8, y=Y_4, z=python_script)
count_4 = List.Count(byCoordinates_7)
chop_4 = List.Chop(byCoordinates_8, count_4)
byPoints_4 = NurbsCurve.ByPoints(chop_4)
byLoft_4 = Surface.ByLoft(byPoints_4)
code_block_9 = CodeBlock { 25; 20; }
byCoordinates_9 = Point.ByCoordinates(x=code_block_9.out0, y=code_block_9.out1)
# note: X 值系列
code_block_10 = CodeBlock { 0..10..#20; }
# note: 振幅
number_slider_9 = DoubleSlider(3, range=0..10 step 0.1)
# note: 频率
number_slider_10 = DoubleSlider(36, range=0..100 step 0.1)
code_block_11 = CodeBlock(amplitude=number_slider_9, frequency=number_slider_10, angle=code_block_10) { amplitude * Math.Cos(frequency * angle); }
byCoordinates_10 = Point.ByCoordinates(x=code_block_10, y=code_block_11)
code_block_12 = CodeBlock(base=byCoordinates_9, pts=byCoordinates_10)
# ---------- code_block_12.designscript (14 lines) ----------
// Make axes from base point
dimension = 10;
top = Point.ByCoordinates(base.X, base.Y + dimension/2);
bottom = Point.ByCoordinates(base.X, base.Y - dimension/2);
right = Point.ByCoordinates(base.X + 10, base.Y);
Line.ByStartPointEndPoint(bottom, top);
Line.ByStartPointEndPoint(base, right);

// Move function results to base point
vec = base.AsVector();
newPts = pts.Add(vec);

// Draw a line through the points
NurbsCurve.ByPoints(newPts);
# ----------------------------------------
code_block_13 = CodeBlock { -5; 20; }
byCoordinates_11 = Point.ByCoordinates(x=code_block_13.out0, y=code_block_13.out1)
code_block_14 = CodeBlock { 0..10..#20; }
# note: 该组示例显示了如何使用节点、公式节点和代码块来图示余弦函数。
# 每个示例均采用一系列数字作为一系列点的 X 值，由 X 值计算 Y 值，然后绘制余弦曲线形状的线条。每个图形终点处的大代码块将绘制的几何图形移动至屏幕的不同部分，以防止它们全部彼此重叠。
number_slider_11 = DoubleSlider(3, range=0..10 step 0.1)
number_slider_12 = DoubleSlider(36, range=0..100 step 0.1)
mul_2 = number_slider_12 * code_block_14
cos = Math.Cos(mul_2)
mul_3 = number_slider_11 * cos
# note: 提示: 可以针对构成几何图形的任何节点启用或禁用“预览”功能。单击鼠标右键，然后选中或取消选中“预览”
byCoordinates_12 = Point.ByCoordinates(x=code_block_14, y=mul_3)
code_block_15 = CodeBlock(base=byCoordinates_11, pts=byCoordinates_12)  # same code as code_block_12
code_block_16 = CodeBlock { 10; 20; }
byCoordinates_13 = Point.ByCoordinates(x=code_block_16.out0, y=code_block_16.out1)
code_block_17 = CodeBlock { 0..10..#20; }
number_slider_13 = DoubleSlider(3, range=0..10 step 0.1)
number_slider_14 = DoubleSlider(36, range=0..100 step 0.1)
# note: 公式节点采用以弧度为单位的角度
degreesToRadians = Math.DegreesToRadians(code_block_17)
formula_2 = Formula("amplitude * cos( frequency * angle)", amplitude=number_slider_13, frequency=number_slider_14, angle=degreesToRadians)
byCoordinates_14 = Point.ByCoordinates(x=code_block_17, y=formula_2)
code_block_18 = CodeBlock(base=byCoordinates_13, pts=byCoordinates_14)  # same code as code_block_12
# note: 节点或代码块中的角度以弧度为单位。
code_block_19 = CodeBlock { 0; 35; }
byCoordinates_15 = Point.ByCoordinates(x=code_block_19.out0, y=code_block_19.out1)
code_block_20 = CodeBlock { 5; 0; }
number_slider_15 = DoubleSlider(247.821, range=0..360 step 0.1)
# note: 移动滑块以更改圆弧的长度。
ZAxis = Vector.ZAxis()
byCenterPointRadiusAngle = Arc.ByCenterPointRadiusAngle(center=byCoordinates_15, radius=code_block_20.out0, startAngle=code_block_20.out1, endAngle=number_slider_15, normal=ZAxis)
endPoint = Curve.EndPoint(byCenterPointRadiusAngle)
byStartPointEndPoint = Line.ByStartPointEndPoint(startPoint=endPoint, endPoint=byCoordinates_15)
startPoint = Curve.StartPoint(byCenterPointRadiusAngle)
byStartPointEndPoint_2 = Line.ByStartPointEndPoint(startPoint=startPoint, endPoint=byCoordinates_15)
# note: 算术运算符，例如
# +、-、*、/、%
# note: 数学
# Dynamo 中的数学可通过公式节点或代码块以及数学库和运算符库中的节点来完成。请参见以下内容了解如何使用三种方法函数执行几个基本数学运算。
code_block_21 = CodeBlock { 5; 2; }
sub = code_block_21.out0 - code_block_21.out1
watch = Watch(sub)
code_block_22 = CodeBlock { 5-2; }
watch_2 = Watch(code_block_22)
formula_3 = Formula("5-2")
watch_3 = Watch(formula_3)
code_block_23 = CodeBlock { 5%2; }
watch_4 = Watch(code_block_23)
formula_4 = Formula("5%2")
watch_5 = Watch(formula_4)
code_block_24 = CodeBlock { 5; 2; }
mod = code_block_24.out0 % code_block_24.out1
watch_6 = Watch(mod)
code_block_25 = CodeBlock { 5<=2; }
watch_7 = Watch(code_block_25)
formula_5 = Formula("5<=2")
watch_8 = Watch(formula_5)
code_block_26 = CodeBlock { 5>2; }
watch_9 = Watch(code_block_26)
formula_6 = Formula("5>2")
watch_10 = Watch(formula_6)
code_block_27 = CodeBlock { 5; 2; }
le = code_block_27.out0 <= code_block_27.out1
watch_11 = Watch(le)
# note: 比较运算符，例如
# <、>、<=、>=、!=、==
code_block_28 = CodeBlock { 5; 2; }
gt = code_block_28.out0 > code_block_28.out1
watch_12 = Watch(gt)
code_block_29 = CodeBlock { 15; 35; }
byCoordinates_16 = Point.ByCoordinates(x=code_block_29.out0, y=code_block_29.out1)
number_slider_16 = DoubleSlider(126.947, range=0..360 step 0.1)
code_block_30 = CodeBlock(center=byCoordinates_16, endAngle=number_slider_16) { Arc.ByCenterPointRadiusAngle(center,5,0,endAngle,Vector.ZAxis()); }
startPoint_2 = Curve.StartPoint(code_block_30)
byStartPointEndPoint_3 = Line.ByStartPointEndPoint(startPoint=startPoint_2, endPoint=byCoordinates_16)
endPoint_2 = Curve.EndPoint(code_block_30)
byStartPointEndPoint_4 = Line.ByStartPointEndPoint(startPoint=endPoint_2, endPoint=byCoordinates_16)
# note: 舍入
code_block_31 = CodeBlock { 3.14159; }
floor = Math.Floor(code_block_31)
watch_13 = Watch(floor)
ceiling = Math.Ceiling(code_block_31)
watch_14 = Watch(ceiling)
round = Math.Round(code_block_31)
watch_15 = Watch(round)
code_block_32 = CodeBlock { 3; }
round_2 = Math.Round(number=code_block_31, digits=code_block_32)
watch_16 = Watch(round_2)
code_block_33 = CodeBlock { 3.14159; }
code_block_34 = CodeBlock(num=code_block_33) { Math.Floor(num); }
watch_17 = Watch(code_block_34)
code_block_35 = CodeBlock(num=code_block_33) { Math.Ceiling(num); }
watch_18 = Watch(code_block_35)
code_block_36 = CodeBlock(num=code_block_33) { Math.Round(num); }
watch_19 = Watch(code_block_36)
code_block_37 = CodeBlock(num=code_block_33) { Math.Round(num,3); }
watch_20 = Watch(code_block_37)
code_block_38 = CodeBlock { 3.14159; }
formula_7 = Formula("floor(num)", num=code_block_38)
watch_21 = Watch(formula_7)
formula_8 = Formula("ceiling(num)", num=code_block_38)
watch_22 = Watch(formula_8)
formula_9 = Formula("round(num,3)", num=code_block_38)
watch_23 = Watch(formula_9)
formula_10 = Formula("round(num,0)", num=code_block_38)
watch_24 = Watch(formula_10)
formula_11 = Formula("true == false")
watch_25 = Watch(formula_11)
formula_12 = Formula("!true")
watch_26 = Watch(formula_12)
formula_13 = Formula("true && false")
watch_27 = Watch(formula_13)
formula_14 = Formula("true || false")
watch_28 = Watch(formula_14)
code_block_39 = CodeBlock { true == false; }
watch_29 = Watch(code_block_39)
code_block_40 = CodeBlock { !true; }
watch_30 = Watch(code_block_40)
code_block_41 = CodeBlock { true && false; }
watch_31 = Watch(code_block_41)
code_block_42 = CodeBlock { true || false; }
watch_32 = Watch(code_block_42)
# note: 布尔运算符
# (在库查找其他运算符。)
boolean = BoolSelector(true)
boolean_2 = BoolSelector(false)
eq = boolean == boolean_2
watch_33 = Watch(eq)
boolean_3 = BoolSelector(true)
boolean_4 = BoolSelector(false)
or_ = boolean_3 || boolean_4
watch_34 = Watch(or_)
boolean_5 = BoolSelector(true)
boolean_6 = BoolSelector(false)
and_ = boolean_5 && boolean_6
watch_35 = Watch(and_)
boolean_7 = BoolSelector(true)
not_ = Not(boolean_7)
watch_36 = Watch(not_)
