# Dynamo graph Core_RangeSyntax.dyn (Dynamo 0.8.0.684)

# note: 数字范围和数字序列比较
number = DoubleInput(0)
number_2 = DoubleInput(10)
number_3 = DoubleInput(2)
number_range = NumberRange(number, number_2, number_3, lacing=Longest)
watch = Watch(number_range)
number_4 = DoubleInput(0)
number_5 = DoubleInput(10)
number_6 = DoubleInput(2)
number_sequence = NumberSeq(number_4, number_5, number_6, lacing=Longest)
watch_2 = Watch(number_sequence)
# note: 数值范围 =
# 起点..终点..步长
code_block = CodeBlock { 0..10..2; }
watch_3 = Watch(code_block)
# note: 数字序列 =
# 起点..#数量..间隔
code_block_2 = CodeBlock { 0..#10..2; }
watch_4 = Watch(code_block_2)
# note: 起点..终点..步长
# note: 可以在代码块或数字节点中使用范围语法。共有多个版本可供选择，具体取决于指定系列的方式。所有这些系列也可以使用库节点集来生成。
#         起点..终点..步长。
#         终点.. #amount..起点。
#         起点.. #amount.. 间隔
# 起点 = 系列开头的数字
# 终点 = 系列结尾的数字
# 步长 = 两个连续数字的差值
# 数量 = 系列中数字的个数
code_block_3 = CodeBlock { 0..10..2; }
# note: 另请参见:
# http://dynamobim.org/dynamo-sequences-and-ranges/
watch_5 = Watch(code_block_3)
# note: 省略步长值
# 等同于设置步长 = 1。
# 起点..终点 = 起点..终点..1
code_block_4 = CodeBlock { 0..10; }
watch_6 = Watch(code_block_4)
# note: 起点..终点..#数量
code_block_5 = CodeBlock { 0..10..#3; }
watch_7 = Watch(code_block_5)
# note: 起点.. #数量..间隔
code_block_6 = CodeBlock { 0..#10..3; }
watch_8 = Watch(code_block_6)
# note: 所有这些都可以采取变量输入
# 只需通过指定未定义的名称即可。
integer_slider = IntegerSlider(5, range=0..10 step 1)
code_block_7 = CodeBlock(howMany=integer_slider) { 0..#howMany..3; }
watch_9 = Watch(code_block_7)
number_7 = DoubleInput(0)
number_slider = DoubleSlider(10, range=0..10 step 0.1)
number_8 = DoubleInput(2)
number_sequence_2 = NumberSeq(number_7, number_slider, number_8, lacing=Longest)
# note: 如果您非常关心列表中数字的个数以及这些数字之间的间距，而不太在意系列的终止位置，则使用数字序列。
# 例如: 设计可停 12 辆车的停车场，您需要适合 12 两汽车，路面边界并不重要。
watch_10 = Watch(number_sequence_2)
# note: 范围语法
# 它完全是关于列表的语法。
# 列表是可视化编程的重要组成部分。写脚本时，会有数字列表、圆列表、Revit 图元列表、甚至还会有对象列表的列表。
number_9 = DoubleInput(0)
number_10 = DoubleInput(10)
number_slider_2 = DoubleSlider(2, range=0..10 step 0.1)
number_range_2 = NumberRange(number_9, number_10, number_slider_2, lacing=Longest)
# note: 如果您非常关心列表的起点和终点，而不太在意有多少项，则可使用数字范围。增大集起点和终点之间的步长值可能导致项数减少。
# 例如：楼梯的台阶高度。楼梯必须开始和终止于楼板标高，其台阶数并不太重要。
watch_11 = Watch(number_range_2)
