# Dynamo graph Core_Strings.dyn (Dynamo 0.8.0.684)

byCoordinates = Point.ByCoordinates()
code_block = CodeBlock { 5; }
byCenterPointRadius = Circle.ByCenterPointRadius(centerPoint=byCoordinates, radius=code_block)
# note: 将对象转换为其自身的字符串说明。
string_from_object = FromObject(byCenterPointRadius)
watch = Watch(string_from_object)
code_block_2 = CodeBlock { "("; ")"; " "; "="; ","; }
# note: 通过指定一个或多个分隔符字符将一个字符串分割为多个。
split = String.Split(watch, code_block_2.out0, code_block_2.out1, code_block_2.out2, code_block_2.out3, code_block_2.out4)
watch_2 = Watch(split)
code_block_3 = CodeBlock { "."; }
# note: 查找字符串是否包含另一字符串。
contains = String.Contains(str=watch_2, searchFor=code_block_3)
watch_3 = Watch(contains)
# note: 指定带 "" 标记的代码块或字符串节点中的字符串。
# note: 字符串
# 该组示例显示了处理字符串的一些可用功能。更多相关功能请参见 Core/String 库。
code_block_4 = CodeBlock { "Few things are harder to put up with than a good example."; }
string = StringInput(" - Mark Twain")
# note: 更改字符串的大小写
toUpper = String.ToUpper(string)
watch_4 = Watch(toUpper)
# note: 将两个字符串连接为一个的操作被称为“concatenating”(合并)，或缩写为“Concat”。
concat = String.Concat(code_block_4, watch_4)
watch_5 = Watch(concat)
code_block_5 = CodeBlock { "put"; }
code_block_6 = CodeBlock { "come"; }
# note: 替换较大字符串内的字符串实例。
replace = String.Replace(str=watch_5, searchFor=code_block_5, replaceWith=code_block_6)
watch_6 = Watch(replace)
code_block_7 = CodeBlock { " to"; }
# note: 查找较大字符串中特定字符串所处位置。
indexOf = String.IndexOf(string=watch_6, searchFor=code_block_7)
watch_7 = Watch(indexOf)
# note: 查找字符串中的字符总数。
length = String.Length(watch_6)
watch_8 = Watch(length)
sub = watch_8 - watch_7
# note: 删除字符串中一定数量的字符。
remove = String.Remove(str=watch_6, startIndex=watch_7, count=sub)
watch_9 = Watch(remove)
code_block_8 = CodeBlock { "ar"; }
# note: 计算较长字符串内某字符串出现的次数。
countOccurrences = String.CountOccurrences(watch_9, code_block_8)
watch_10 = Watch(countOccurrences)
