# Dynamo graph Geometry_Surfaces.dyn (Dynamo 0.8.0.760)

number = DoubleInput(10)
byCoordinates = Point.ByCoordinates(y=number)
number_2 = DoubleInput(5)
number_3 = DoubleInput(10)
byCoordinates_2 = Point.ByCoordinates(x=number_2, y=number_3, z=number_3)
number_4 = DoubleInput(15)
byCoordinates_3 = Point.ByCoordinates(x=number_4, y=number_4)
byThreePoints = Arc.ByThreePoints(firstPoint=byCoordinates, secondPoint=byCoordinates_2, thirdPoint=byCoordinates_3)
byCoordinates_4 = Point.ByCoordinates()
number_5 = DoubleInput(5)
byCoordinates_5 = Point.ByCoordinates(z=number_5)
byCoordinates_6 = Point.ByCoordinates(x=number)
byThreePoints_2 = Arc.ByThreePoints(firstPoint=byCoordinates_4, secondPoint=byCoordinates_5, thirdPoint=byCoordinates_6)
number_6 = DoubleInput(-5)
number_7 = DoubleInput(5)
byCoordinates_7 = Point.ByCoordinates(x=number_6, y=number_7)
byThreePoints_3 = Arc.ByThreePoints(firstPoint=byCoordinates_4, secondPoint=byCoordinates_7, thirdPoint=byCoordinates)
# note: 大多数曲面有多种创建方法。通过点、曲线和从其他曲面和实体提取的数据可创建曲面、Polysurfaces (曲面集合)和 Nurbs 曲面
bySweep2Rails = Surface.BySweep2Rails(path=byThreePoints, guideRail=byThreePoints_2, profile=byThreePoints_3)
# note: 几何图形与 Revit 图元不同:
# 使用导入实例由任意 Revit 环境中的曲面和实体来创建 Revit 导入，使用点和曲线布置族实例，或通过点(自适应构件)族在体量和常规模型中创建表格
byGeometries = ImportInstance.ByGeometries(bySweep2Rails)
number_8 = DoubleInput(10)
number_9 = DoubleInput(-10)
byCoordinates_8 = Point.ByCoordinates(x=number_8, y=number_9)
byCoordinates_9 = Point.ByCoordinates(y=number_9)
byStartPointEndPoint = Line.ByStartPointEndPoint(startPoint=byCoordinates_8, endPoint=byCoordinates_9)
create = List.Create(byStartPointEndPoint, byThreePoints_2)
byLoft = Surface.ByLoft(create)
area = Surface.Area(byLoft)
watch = Watch(area)
# note: 已连接为 Polysurfaces 的曲面可以作为单个实体计算
create_2 = List.Create(byLoft, bySweep2Rails)
byJoinedSurfaces = PolySurface.ByJoinedSurfaces(create_2)
area_2 = Surface.Area(byJoinedSurfaces)
watch_2 = Watch(area_2)
area_3 = Surface.Area(bySweep2Rails)
watch_3 = Watch(area_3)
number_10 = DoubleInput(0..1..0.1)
# note: 使用适合这些几何图形的“操作”，可由曲面提取边、点和其他要素
pointAtParameter = Surface.PointAtParameter(surface=bySweep2Rails, u=number_10, v=number_10, lacing=CrossProduct)
# note: 提示: 取消选中右键菜单上的“预览上游”以隔离节点中的几何图形
byControlPoints = NurbsSurface.ByControlPoints(controlVertices=pointAtParameter)
watch_3d = Watch3D(byControlPoints)
code_block = CodeBlock { 10; }
extrude = Curve.Extrude(curve=byThreePoints, distance=code_block)
referenceCurveByCurve = ModelCurve.ReferenceCurveByCurve(create)
byLoftCrossSections = Form.ByLoftCrossSections(referenceCurveByCurve)
