# Dynamo graph Geometry_Solids.dyn (Dynamo 0.8.0.760)

byCoordinates = Point.ByCoordinates()
number = DoubleInput(10)
byCoordinates_2 = Point.ByCoordinates(x=number)
byStartPointEndPoint = Line.ByStartPointEndPoint(startPoint=byCoordinates, endPoint=byCoordinates_2)
number_2 = DoubleInput(5)
byCoordinates_3 = Point.ByCoordinates(z=number_2)
byThreePoints = Arc.ByThreePoints(firstPoint=byCoordinates, secondPoint=byCoordinates_3, thirdPoint=byCoordinates_2)
create = List.Create(byStartPointEndPoint, byThreePoints)
byJoinedCurves = PolyCurve.ByJoinedCurves(create)
byCoordinates_4 = Point.ByCoordinates(y=number)
number_3 = DoubleInput(15)
byCoordinates_5 = Point.ByCoordinates(x=number_3, y=number_3)
byStartPointEndPoint_2 = Line.ByStartPointEndPoint(startPoint=byCoordinates_4, endPoint=byCoordinates_5)
number_4 = DoubleInput(5)
number_5 = DoubleInput(10)
byCoordinates_6 = Point.ByCoordinates(x=number_4, y=number_5, z=number_5)
byThreePoints_2 = Arc.ByThreePoints(firstPoint=byCoordinates_4, secondPoint=byCoordinates_6, thirdPoint=byCoordinates_5)
create_2 = List.Create(byStartPointEndPoint_2, byThreePoints_2)
byJoinedCurves_2 = PolyCurve.ByJoinedCurves(create_2)
create_3 = List.Create(byJoinedCurves, byJoinedCurves_2)
byLoft = Solid.ByLoft(create_3)
volume = Solid.Volume(byLoft)
code_block = CodeBlock { 0; }
# note: 提示: 禁用节点右键菜单中的“预览”，以禁止显示图元
thinShell = Solid.ThinShell(byLoft, code_block)
code_block_2 = CodeBlock { Vector.ByCoordinates(20,0,0); }
translate = Geometry.Translate(geometry=thinShell, direction=code_block_2)
code_block_3 = CodeBlock { Point.ByCoordinates(0,0,5); }
ZAxis = Vector.ZAxis()
byOriginNormal = Plane.ByOriginNormal(origin=code_block_3, normal=ZAxis)
code_block_4 = CodeBlock { Point.ByCoordinates(10,10,10); }
# note: 几何图形类别中可使用几何图形各项布尔运算(交集、差集、并集等)。
trim = Geometry.Trim(geometry=translate, other=byOriginNormal, pick=code_block_4)
number_6 = DoubleInput(-2)
number_7 = DoubleInput(5)
byCoordinates_7 = Point.ByCoordinates(x=number_6, y=number_7)
create_4 = List.Create(byCoordinates, byCoordinates_7, byCoordinates_4)
byPoints = NurbsCurve.ByPoints(create_4)
# note: 大多数实体有多种创建方法。这些示例将闭合轮廓显示为基础，但多重曲面可以缝合，并可使用许多基本体(曲面、长方体、圆锥体等等)
byLoft_2 = Solid.ByLoft(create_3, byPoints)
code_block_5 = CodeBlock { Vector.ByCoordinates(-20,0,0); }
translate_2 = Geometry.Translate(geometry=byLoft_2, direction=code_block_5)
# note: 几何图形与 Revit 图元不同:
# 使用 ImportInstance 由任意 Revit 环境中的曲面和实体来创建 Revit 导入，使用点和曲线布置族实例，或通过点(自适应构件)族在体量和常规模型中创建表格
byGeometries = ImportInstance.ByGeometries(translate_2)
curves = PolyCurve.Curves(create_3)
referenceCurveByCurve = ModelCurve.ReferenceCurveByCurve(curves)
byLoftCrossSections = Form.ByLoftCrossSections(referenceCurveByCurve)
