# Dynamo graph Combine.dyn (Dynamo 0.8.1.1942)

pointAtParameter = Curve.PointAtParameter()
code_block = CodeBlock { 0..20..#4; 20; }
byCoordinates = Point.ByCoordinates(x=code_block.out0)
byCoordinates_2 = Point.ByCoordinates(x=code_block.out0, y=code_block.out1)
byStartPointEndPoint = Line.ByStartPointEndPoint(startPoint=byCoordinates, endPoint=byCoordinates_2)
watch = Watch(byStartPointEndPoint)
code_block_2 = CodeBlock { 0..1..#3; 0..1..#4; 0..1..#5; 0..1..#6; }
create = List.Create(code_block_2.out0, code_block_2.out1, code_block_2.out2, code_block_2.out3)
watch_2 = Watch(create)
combine = List.Combine(pointAtParameter, watch, watch_2)
watch_3 = Watch(combine)
