# Dynamo graph n-Dimensional-Lists.dyn (Dynamo 0.8.1.1942)

file_path = Filename("C:\node\Dynamo-Primer-20150701\dynamo-primer\06_Designing-with-Lists\datasets\6-4\n-Dimensional-Lists.sat")
importFromSAT = Geometry.ImportFromSAT(file_path)
code_block = CodeBlock { 1; }
getItemAtIndex = List.GetItemAtIndex(list=importFromSAT, index=code_block)
code_block_2 = CodeBlock { 0..1..#10; 0..1..#5; }
pointAtParameter = Surface.PointAtParameter(surface=getItemAtIndex, u=code_block_2.out0, v=code_block_2.out1, lacing=CrossProduct)
byPoints = NurbsCurve.ByPoints(pointAtParameter)
transpose = List.Transpose(pointAtParameter)
byPoints_2 = NurbsCurve.ByPoints(transpose)
file_path_2 = Filename("C:\node\Dynamo-Primer-20150701\dynamo-primer\06_Designing-with-Lists\datasets\6-4\n-Dimensional-Lists.sat")
importFromSAT_2 = Geometry.ImportFromSAT(file_path_2)
code_block_3 = CodeBlock { 0..1..#20; 0..1..#20; 0..1..#10; }
pointAtParameter_2 = Surface.PointAtParameter(surface=importFromSAT_2, u=code_block_3.out0, v=code_block_3.out1, lacing=CrossProduct)
byPoints_3 = NurbsCurve.ByPoints(pointAtParameter_2)
code_block_4 = CodeBlock { 10; 10; 10; 10; }
offset = Surface.Offset(importFromSAT_2, code_block_4.out0)
pointAtParameter_3 = Surface.PointAtParameter(surface=offset, u=code_block_3.out0, v=code_block_3.out1, lacing=CrossProduct)
byPoints_4 = NurbsCurve.ByPoints(pointAtParameter_3)
create = List.Create(byPoints_3, byPoints_4)
transpose_2 = List.Transpose(create)
create_2 = List.Create()
combine = List.Combine(create_2, byPoints_3, byPoints_4)
byLoft = Surface.ByLoft(combine)
transpose_3 = List.Transpose()
map = List.Map(list=pointAtParameter_2, f_x=transpose_3)
transpose_4 = List.Transpose()
map_2 = List.Map(list=pointAtParameter_3, f_x=transpose_4)
transpose_5 = List.Transpose()
map_3 = List.Map(list=combine, f_x=transpose_5)
byLoft_2 = Surface.ByLoft(map_3)
code_block_5 = CodeBlock { 3; }
boolean = BoolSelector(true)
thicken = Surface.Thicken(surface=byLoft_2, thickness=code_block_5, both_sides=boolean)
byLoft_3 = Surface.ByLoft(create)
code_block_6 = CodeBlock { 0; }
getItemAtIndex_2 = List.GetItemAtIndex(list=byLoft_3, index=code_block_6)
thicken_2 = Surface.Thicken(surface=getItemAtIndex_2, thickness=code_block_5, both_sides=boolean)
file_path_3 = Filename("C:\node\Dynamo-Primer-20150701\dynamo-primer\06_Designing-with-Lists\datasets\6-4\n-Dimensional-Lists.sat")
importFromSAT_3 = Geometry.ImportFromSAT(file_path_3)
code_block_7 = CodeBlock { 1; }
getItemAtIndex_3 = List.GetItemAtIndex(list=importFromSAT_3, index=code_block_7)
code_block_8 = CodeBlock { 0..1..#10; 0..1..#5; }
pointAtParameter_4 = Surface.PointAtParameter(surface=getItemAtIndex_3, u=code_block_8.out0, v=code_block_8.out1, lacing=CrossProduct)
byPoints_5 = NurbsCurve.ByPoints(pointAtParameter_4)
code_block_9 = CodeBlock { 10; }
offset_2 = Surface.Offset(getItemAtIndex_3, code_block_9)
pointAtParameter_5 = Surface.PointAtParameter(surface=offset_2, u=code_block_8.out0, v=code_block_8.out1, lacing=CrossProduct)
byPoints_6 = NurbsCurve.ByPoints(pointAtParameter_5)
create_3 = List.Create(byPoints_5, byPoints_6)
byLoft_4 = Surface.ByLoft(create_3)
transpose_6 = List.Transpose(create_3)
byLoft_5 = Surface.ByLoft(transpose_6)
create_4 = List.Create()
combine_2 = List.Combine(create_4, byPoints_5, byPoints_6)
byLoft_6 = Surface.ByLoft(combine_2)
transpose_7 = List.Transpose(pointAtParameter_4)
transpose_8 = List.Transpose(pointAtParameter_5)
