# Dynamo graph Core_PassingFunctions.dyn (Dynamo 0.8.0.684)

# note: 传递函数
# Dynamo 是函数语言，这意味能以处理“对象”的方式处理“操作”。Dynamo 中的大多数节点可转换为函数并能以非常精确的方式用于一组数据。
# 生成函数并传递函数类似于说出命令“运行 20 分钟！”并随后指定针对对象。
# 在该示例中，圆的网格表示为复杂结构。直接使用选择圆集的命令，然后传递命令而不是作为函数以降低不同结果数据的级别。
code_block = CodeBlock { 0..#8..4; }
code_block_2 = CodeBlock { 0..#5..4; }
byCoordinates = Point.ByCoordinates(x=code_block, y=code_block_2, lacing=CrossProduct)
# note: 该点列表采用层次结构方式，是由列表组成的列表。网格由 X 轴方向的 8 个点和 Y 轴方向的 5 个点构成。该列表即表示 8 个分别包含 5 个对象的列表，或包含对应数量点和列的列表。
watch = Watch(byCoordinates)
code_block_3 = CodeBlock { 1.5; }
# note: 绕每个点绘制圆。
byCenterPointRadius = Circle.ByCenterPointRadius(centerPoint=watch, radius=code_block_3)
# note: 从圆的嵌套列表中，选择项 {1,2}。Dynamo 节点将始终“从外向内”或从最高级别到最低级别作用于列表。
# 从列表中选择项 1 和 2 将从原嵌套列表结构返回列表 #1 和列表 #2。
code_block_4 = CodeBlock { 1..2; }
getItemAtIndex = List.GetItemAtIndex(list=byCenterPointRadius, index=code_block_4)
# note: 选定数据仍位于通过贴图方式将其选中前的同一结构内。
watch_2 = Watch(getItemAtIndex)
code_block_5 = CodeBlock { 3; }
# note: 该列表中的圆将被向上拉伸。
extrude = Curve.Extrude(curve=watch_2, distance=code_block_5)
code_block_6 = CodeBlock { 1..2; }
# note: List。GetItemAtIndex 可用作函数和传递到每个列表。
# 若要将 List.GetItemAtIndex 转换为函数，请让列表输入处于“不满”状态并将节点输出传递到 List.Map 节点的函数输入。该 List.Map 函数然后从每个列表提取 #1 和 #2 项，而不是前两个列表。
getItemAtIndex_2 = List.GetItemAtIndex(index=code_block_6)
map = List.Map(list=byCenterPointRadius, f_x=getItemAtIndex_2)
watch_3 = Watch(map)
code_block_7 = CodeBlock { -3; }
# note: 该列表中的圆将被向下拉伸。
extrude_2 = Curve.Extrude(curve=watch_3, distance=code_block_7)
