# Dynamo graph Documenting.dyn (Dynamo 0.8.2.2032)

code_block = CodeBlock { "XYZ1"; "XYZ2"; "XYZ3"; "XYZ4"; }
create = List.Create(code_block.out0, code_block.out1, code_block.out2, code_block.out3)
setParameterByName = Element.SetParameterByName(parameterName=create)
family_types = FamilyTypes("ROOF-PANEL-4PT:ROOF-PANEL-4PT")
all_elements_of_family_type = ElementsOfFamilyType(family_types)
locations = AdaptiveComponent.Locations(all_elements_of_family_type)
string_from_object = FromObject(locations)
combine = List.Combine(setParameterByName, all_elements_of_family_type, string_from_object)
