# Dynamo custom node MapPolygonsToSurface.dyf (Dynamo 0.8.3.2391)
# category: Geometry.Curve
# Map polygon(s) from a base to a target surface

targetSurface = Input(targetSurface : Surface)
baseSurface = Input(baseSurface : Surface)
polygons = Input(polygons : Polygon)
points = Polygon.Points(polygons)
UVParameterAtPoint = Surface.UVParameterAtPoint(baseSurface, points)
U = UV.U(UVParameterAtPoint)
V = UV.V(UVParameterAtPoint)
pointAtParameter = Surface.PointAtParameter(surface=targetSurface, u=U, v=V)
boolean = BoolSelector(true)
byPoints = PolyCurve.ByPoints(points=pointAtParameter, connectLastToFirst=boolean)
byPatch = Surface.ByPatch(byPoints)
surfacePatches = Output(byPatch)
Polygons = Output(byPoints)
