# Dynamo graph UVmapping_Custom-Node.dyn (Dynamo 0.8.3.2391)

file_path = Filename("C:\Users\Mode Lab_01\Documents\MODE LAB\CONSULTING\AUTODESK\DYNAMO PRIMER\UVmapping_srf.sat")
importFromSAT = Geometry.ImportFromSAT(file_path)
code_block = CodeBlock { 100; }
byWidthLength = Rectangle.ByWidthLength(width=code_block, length=code_block)
byPatch = Surface.ByPatch(byWidthLength)
code_block_2 = CodeBlock { -45..45..#10; }
byCoordinates = Point.ByCoordinates(x=code_block_2, y=code_block_2, lacing=CrossProduct)
byOriginNormal = Plane.ByOriginNormal(origin=byCoordinates)
code_block_3 = CodeBlock { 10; }
byWidthLength_2 = Rectangle.ByWidthLength(plane=byOriginNormal, width=code_block_3, length=code_block_3)
points = Polygon.Points(byWidthLength_2)
UVParameterAtPoint = Surface.UVParameterAtPoint(byPatch, points)
U = UV.U(UVParameterAtPoint)
V = UV.V(UVParameterAtPoint)
pointAtParameter = Surface.PointAtParameter(surface=importFromSAT, u=U, v=V)
boolean = BoolSelector(true)
byPoints = PolyCurve.ByPoints(points=pointAtParameter, connectLastToFirst=boolean)
byPatch_2 = Surface.ByPatch(byPoints)
