# Dynamo graph Revit_Color.dyn (Dynamo 0.8.1.976)

# note: 获取墙
# note: 运行该图形 DynamoSample.rvt 文件，该文件位于 Dynamo 安装文件的 Samples 文件夹中
# C:\ProgramData\Dynamo\(Dynamo 版本)\samples\Revit
# note: 根据部分可衡量标准对 Revit 图元着色
select_model_elements = DSModelElementsSelection()  # 10 picked in the model
number = DoubleInput(0)
number_2 = DoubleInput(255)
byARGB = Color.ByARGB(a=number, r=number, g=number_2, b=number, lacing=Longest)
number_3 = DoubleInput(0)
number_4 = DoubleInput(255)
byARGB_2 = Color.ByARGB(a=number_3, r=number_4, g=number_3, b=number_3, lacing=Longest)
create = List.Create(byARGB, byARGB_2)
code_block = CodeBlock { {0,1}; }
geometry = Element.Geometry(select_model_elements)
flatten = Flatten(geometry)
# note: 提取几何图形的曲面面积
area = Solid.Area(flatten)
# note: 在最高值处规范化
maximumItem = List.MaximumItem(area)
div = area / maximumItem
color_range = ColorRange(create, code_block, div)
# note: 设置颜色范围
overrideColorInView = Element.OverrideColorInView(element=select_model_elements, color=color_range, lacing=Longest)
number_5 = DoubleInput(50)
# note: 获取最大值
# note: 确定公差范围内的面积
# note: 或
formula = Formula("if(x>y,1,0)", x=area, y=number_5, lacing=Longest)
