# Dynamo graph Revit_Floors and Framing.dyn (Dynamo 0.8.0.760)

# note: 装饰性建筑的中心
# note: 运行该图形 DynamoSample.rvt 文件，该文件位于 Dynamo 安装文件的 Samples 文件夹中
# C:\ProgramData\Dynamo\(Dynamo 版本)\samples\Revit
# note: 该定义使用一系列线条来创建装饰性建筑，并使用这些线条来推动结构框架和楼板的布置。
number = DoubleInput(15)
number_2 = DoubleInput(-10)
number_3 = DoubleInput(-0.25)
byCoordinates = Point.ByCoordinates(x=number, y=number_2, z=number_3)
# note: 楼层高度
number_4 = DoubleInput(5)
number_5 = DoubleInput(-0.75)
number_sequence = NumberSeq(number_4, number_4, number_5, lacing=Longest)
# note: 生成一组多边形
byCenterPointRadius = Circle.ByCenterPointRadius(centerPoint=byCoordinates, radius=number_sequence)
number_6 = DoubleInput(5)
regularPolygon = Polygon.RegularPolygon(circle=byCenterPointRadius, numberSides=number_6)
number_7 = DoubleInput(0)
code_block = CodeBlock(x=number_4) { 0..20..#x; }
byCoordinates_2 = Vector.ByCoordinates(x=number_7, y=number_7, z=code_block)
# note: 向上移动多边形并旋转
translate = Geometry.Translate(geometry=regularPolygon, direction=byCoordinates_2)
ZAxis = Vector.ZAxis()
code_block_2 = CodeBlock(count=number_4) { 0..45..#count; }
rotate = Geometry.Rotate(geometry=translate, origin=byCoordinates, axis=ZAxis, degrees=code_block_2)
# note: 从多边形提取单个曲线
curves = PolyCurve.Curves(rotate)
floor_types = FloorTypes("Generic 300")
levels = Levels("Foundation")
# note: 穿过各组曲线以创建楼板
byOutlineTypeAndLevel = Floor.ByOutlineTypeAndLevel(outline=curves, floorType=floor_types, level=levels)
endPoint = Curve.EndPoint(curves)
# note: 连接多边形的上匹配边以创建支撑
transpose = List.Transpose(endPoint)
byPoints = PolyCurve.ByPoints(points=transpose)
curves_2 = PolyCurve.Curves(byPoints)
levels_2 = Levels("Level 1 Living Rm.")
structural_framing_types = StructuralFramingTypes("HSS8-3/4X.375")
# note: 穿过每个结构图元的单个曲线
beamByCurve = StructuralFraming.BeamByCurve(curves_2, levels_2, structural_framing_types)
