# Dynamo graph Revit_StructuralFraming.dyn (Dynamo 0.8.0.760)

# note: 运行该图形 DynamoSample.rvt 文件，该文件位于 Dynamo 安装文件的 Samples 文件夹中
# C:\ProgramData\Dynamo\(Dynamo 版本)\samples\Revit
# note: 相对于从 Revit 文件选定的某些图元布置结构框架
select_model_element = DSModelElementSelection()  # 1 picked in the model
geometry = Element.Geometry(select_model_element)
integer_slider = IntegerSlider(9, range=2..10 step 1)
code_block = CodeBlock(x=integer_slider) { 0..1..#x; }
pointAtParameter = Curve.PointAtParameter(curve=geometry, param=code_block, lacing=CrossProduct)
# note: 模型曲线已选定，其图元 ID 与该文件一起保存
select_model_element_2 = DSModelElementSelection()  # 1 picked in the model
# note: 从 Revit 图元分离几何图形
geometry_2 = Element.Geometry(select_model_element_2)
# note: 沿直线创建点
pointAtParameter_2 = Curve.PointAtParameter(curve=geometry_2, param=code_block, lacing=CrossProduct)
byStartPointEndPoint = Line.ByStartPointEndPoint(startPoint=pointAtParameter, endPoint=pointAtParameter_2)
flatten = Flatten(byStartPointEndPoint)
levels = Levels("Ceiling")
structural_framing_types = StructuralFramingTypes("1 3/4x14")
# note: 布置结构框架
beamByCurve = StructuralFraming.BeamByCurve(flatten, levels, structural_framing_types)
